# Grasshopper definition 221024_Barcelona_Resistance_3D.gh (Grasshopper 1.0.7)
# plug-ins: Hops, Bifocals, Urbano, Human, Wombat

# ---- group: Tools_Archive
utm = Data()
vec = Data()

# ----
# Ctrl C + Ctrl V from
#  https://boundingbox.klokantech.com/
https_boundingbox_klokantech_com_exporte = Panel("1.78552,41.219357,2.402815,41.649202")  # "https://boundingbox.klokantech.com/ exported as CSV"

path = FilePath()
importshp = ImportShapefileFeatures(ShapefilePath=path, Reproject=True)  # -> Points, Metadata, UTMZone, TranslationVector
pline = PolyLine(Vertices=importshp.Points, Closed=False)

path_2 = FilePath()
importshp_2 = ImportShapefileFeatures(ShapefilePath=path_2, Reproject=True, UTMZone=importshp.UTMZone, TranslationVector=importshp.TranslationVector)  # -> Points, Metadata, UTMZone, TranslationVector
pline_2 = PolyLine(Vertices=importshp_2.Points, Closed=False)
lookup = LookupMetadata(MetadataGeometry=importshp_2.Metadata, SearchKey="STRAHLER")
item = ListItem(List=importshp_2.Metadata, Index=Slider(0, range=0..100), Wrap=True)
bnd = Bounds(Numbers=lookup)
demeta = DeconstructMetadata(Metadata=item)  # -> Keys, Values
dedomain = DeconstructDomain(Domain=bnd)  # -> Start, End
gradient = Gradient(LowerLimit=dedomain.Start, UpperLimit=dedomain.End, Parameter=lookup, stops=[0: RGB(255, 255, 255), 1: RGB(0, 0, 0)])
preview = CustomPreview(Geometry=flatten(pline_2), Material=gradient)
previewlw = CustomPreviewLineweights(
    Shader={diffuse=RGB(255, 105, 180), emission=RGB(76, 32, 54), shine=0.5, specular=RGB(255, 255, 255), transparency=0},
    Absolute=False)

path_3 = FilePath("Z:\.shortcut-targets-by-id\1SywzPMZPhkdick32NCYa-c09GZFcjx9F\Internet_of_Boars\IoB_Files\1_WORKING FILES\GIS\SPATIAL DATA\REDA'S DATABASE\CLC 2018 landcovers\rivers selected\rivers selected.shp")
# Agricultural Areas we want to preserve
path_4 = FilePath("Z:\.shortcut-targets-by-id\1SywzPMZPhkdick32NCYa-c09GZFcjx9F\Internet_of_Boars\IoB_Files\1_WORKING FILES\GIS\SPATIAL DATA\REDA'S DATABASE\CLC 2018 landcovers\agriculture and farms\CLC 2018_agricultural and farms layer.shp")

# ----
# rectangle to extract
#  maps from
https_boundingbox_klokantech_com_exporte_2 = Panel("1.2537,41.0952,2.7254,41.9541")  # "https://boundingbox.klokantech.com/ exported as CSV"

split = TextSplit(Text=https_boundingbox_klokantech_com_exporte_2, Separators=",")
item_2 = ListItem(List=split, Index=0, Wrap=True)  # -> Item, Item1, Item2, Item3
pt = ConstructPoint(XCoordinate=item_2.Item2, YCoordinate=item_2.Item3, ZCoordinate=0)
pt_2 = ConstructPoint(XCoordinate=item_2.Item, YCoordinate=item_2.Item1, ZCoordinate=0)
rec_2pt = Rectangle2Pt(Plane=PlaneXY(0, 0, 0), PointA=pt_2, PointB=pt, Radius=0)  # -> Rectangle, Length

# ----
# dam to
# renew data
# incrementally
dam = DataDam(DataA=rec_2pt.Rectangle, BufferDelay=10000000, BufferMode=0)

# ----
# map poligon defined
crv = Curve(flatten(dam))

panel = Panel(crv)

disc = Discontinuity(Level=1)  # -> Points, Parameters

# ----
# .../ee_image
hops = Hops(
    Layer="CGIAR/SRTM90_V4",
    Bands="elevation",
    Mode="mean",
    Scale=Slider(476, range=0..1000),
    Pts=disc.Points,
    CacheResultsInMemory=True,
    CacheSolveResults=True,
    RemoteDefinitionLocation="http://127.0.0.1:5000/ee_image",
    RemoteSolveVersion=(0, 1, 0),
    ShowInput_Enabled=False,
    ShowInput_Path=False,
    SynchronousSolve=False)  # -> Values, W, H

bnd_2 = Bounds(Numbers=hops.Values)
dedomain_2 = DeconstructDomain(Domain=bnd_2)  # -> Start, End
gradient_2 = Gradient(
    LowerLimit=dedomain_2.Start,
    UpperLimit=dedomain_2.End,
    Parameter=hops.Values,
    stops=[0: RGB(255, 255, 255), 1: RGB(0, 0, 0)])

# ----
# .../ee_image
panel_2 = Panel("CGIAR/SRTM90_V4")
disc_2 = Discontinuity(Curve=crv, Level=1)  # -> Points, Parameters
reproj = Hops(
    Points=disc_2.Points,
    Bool=Toggle(False),
    CacheResultsInMemory=False,
    CacheSolveResults=False,
    RemoteDefinitionLocation="http://127.0.0.1:5000/reproject_UTM",
    RemoteSolveVersion=(0, 1, 0),
    ShowInput_Enabled=False,
    ShowInput_Path=False,
    SynchronousSolve=False)
hops_2 = Hops(
    Layer=panel_2,
    Bands="elevation",
    Mode="mean",
    Scale=Slider(736, range=0..1000),
    Pts=disc_2.Points,
    CacheResultsInMemory=True,
    CacheSolveResults=True,
    RemoteDefinitionLocation="http://127.0.0.1:5000/ee_image",
    RemoteSolveVersion=(0, 1, 0),
    ShowInput_Enabled=False,
    ShowInput_Path=False,
    SynchronousSolve=False)  # -> Values, W, H
bnd_3 = Bounds(Numbers=hops_2.Values)
dedomain_3 = DeconstructDomain(Domain=bnd_3)  # -> Start, End
num = Number(3)
gradient_3 = Gradient(
    LowerLimit=dedomain_3.Start,
    UpperLimit=dedomain_3.End,
    Parameter=hops_2.Values,
    stops=[0: RGB(255, 255, 255), 1: RGB(0, 0, 0)])
multiplication = Multiplication(A=hops_2.Values, B=Slider(1, range=1..5))
Z = UnitZ(Factor=multiplication)

bnd_4 = Bounds(Numbers=multiplication)
dedomain_4 = DeconstructDomain(Domain=bnd_4)  # -> Start, End
Z_2 = UnitZ(Factor=dedomain_4.End)

# ---- group: .../reproject_UTM
reproj_2 = Hops(
    Points=disc.Points,
    Bool=Toggle(True),
    CacheResultsInMemory=False,
    CacheSolveResults=False,
    RemoteDefinitionLocation="http://127.0.0.1:5000/reproject_UTM",
    RemoteSolveVersion=(0, 1, 0),
    ShowInput_Enabled=False,
    ShowInput_Path=False,
    SynchronousSolve=False)

# ----
pline_3 = PolyLine(Vertices=reverse(reproj_2), Closed=invert(False))
mplane = MeshPlane(Boundary=pline_3, WidthCount=hops.W, HeightCount=hops.H)  # -> Mesh, Area

# ----
# Rivers
importshp_3 = ImportShapefileFeatures(ShapefilePath=path_3, Reproject=True)  # -> Points, Metadata, UTMZone, TranslationVector
pline_4 = PolyLine(Vertices=importshp_3.Points, Closed=False)
number_slider = Slider(10, range=0..1010)  # disabled
redpline = Reduce(Polyline=pline_4, Tolerance=number_slider)  # -> Polyline, Reduction; disabled

vec_2 = Vector(importshp_3.TranslationVector)
importshp_4 = ImportShapefileFeatures(ShapefilePath=path_4, Reproject=True, UTMZone=importshp_3.UTMZone, TranslationVector=importshp_3.TranslationVector)  # -> Points, Metadata, UTMZone, TranslationVector
move = Move(Geometry=reproj, Motion=vec_2)  # -> Geometry, Transform
pline_5 = PolyLine(Vertices=importshp_4.Points, Closed=False)

pline_6 = PolyLine(Vertices=reverse(move.Geometry), Closed=invert(False))
mplane_2 = MeshPlane(Boundary=pline_6, WidthCount=hops_2.W, HeightCount=hops_2.H)  # -> Mesh, Area
demesh = DeconstructMesh(Mesh=mplane_2.Mesh)  # -> Vertices, Faces, Colours, Normals
move_2 = Move(Geometry=demesh.Vertices, Motion=Z)  # -> Geometry, Transform
conmesh = ConstructMesh(Vertices=move_2.Geometry, Faces=demesh.Faces, Colours=gradient_3)
contour = Contour(Shape=conmesh, Point=Point(0, 0, 0), Direction=Vector(0, 0, 1), Distance="50")

redpline_2 = Reduce(Polyline=pline_5, Tolerance=Slider(10, range=0..1010))  # -> Polyline, Reduction

crv_2 = Curve(redpline.Polyline)  # disabled
cls = Closed(Curve=crv_2)  # -> Closed, Periodic; disabled
dispatch = Dispatch(List=crv_2, DispatchPattern=cls.Closed)  # -> ListA, ListB; disabled
crv_3 = Curve(dispatch.ListA)  # disabled

crv_4 = Curve(redpline_2.Polyline)
cls_2 = Closed(Curve=crv_4)  # -> Closed, Periodic
dispatch_2 = Dispatch(List=crv_4, DispatchPattern=cls_2.Closed)  # -> ListA, ListB
crv_5 = Curve(dispatch_2.ListA)

boundarym = BoundaryMesh(Polyline=crv_3)  # disabled

boundarym_2 = BoundaryMesh(Polyline=crv_5)

trim = TrimTree(Tree=boundarym, Depth=1)  # disabled
mjoin = MeshJoin(Meshes=trim)  # disabled

dam_2 = DataDam(DataA=crv_5, BufferDelay=10000000, BufferMode=0)
trim_2 = TrimTree(Tree=boundarym_2, Depth=1)
data = Data(conmesh)
mjoin_2 = MeshJoin(Meshes=trim_2)
extrudem = ExtrudeAsMesh(Polyline=dam_2, Direction=Z_2, Cap=True)
mint = MeshIntersection(MeshesA=data)

multiplication_2 = Multiplication(A=Slider(1, range=0..100), B=hops.Values)
Z_3 = UnitZ(Factor=multiplication_2)

demesh_2 = DeconstructMesh(Mesh=mplane.Mesh)  # -> Vertices, Faces, Colours, Normals

move_3 = Move(Geometry=demesh_2.Vertices, Motion=Z_3)  # -> Geometry, Transform

conmesh_2 = ConstructMesh(Vertices=move_3.Geometry, Faces=demesh_2.Faces, Colours=gradient_2)
