# Grasshopper definition 221104_AXO_CONNECTIVITY_LANDUSES_Roman ed02.gh (Grasshopper 1.0.7)
# plug-ins: Bifocals, Urbano, Wombat, Kangaroo2 Components

# ----
# Boundary
path = FilePath("C:\Users\Christos Grapas\Desktop\IAAC\IAAC_UCD\class 2\Class_2\bcn_prov\Barcelona_prov_4326.shp")
importshp = ImportShapefileFeatures(ShapefilePath=path, Reproject=True)  # -> Points, Metadata, UTMZone, TranslationVector
pline = PolyLine(Vertices=importshp.Points, Closed=False)
redpline = Reduce(Polyline=pline, Tolerance=Slider(100, range=0..1010))  # -> Polyline, Reduction

crv = Curve(<curve referenced from the Rhino model>)

# ---- group: Grid_Settings
number_slider = Slider(1000, range=0..1000)
rectangle = Rectangle(Plane=PlaneXY(0, 0, 0), XSize=number_slider, YSize=number_slider, Radius=0)  # -> Rectangle, Length
number_slider_2 = Slider(100, range=0..1000)
pt = ConstructPoint(XCoordinate=0, YCoordinate=0, ZCoordinate=0)
arrrec = RectangularArray(Geometry=pt, Cell=rectangle.Rectangle, XCount=number_slider_2, YCount=number_slider_2)  # -> Geometry, Transform
bbox = BoundingBox(Content=arrrec.Geometry, Plane=PlaneXY(0, 0, 0), UnionBox=True)  # -> Box, Box_2
srf_cp = SurfaceClosestPoint(Point=arrrec.Geometry, Surface=reparameterize(bbox.Box))  # -> Point, UVPoint, Distance

# ----
bbox_2 = FilePath("Z:\.shortcut-targets-by-id\1SywzPMZPhkdick32NCYa-c09GZFcjx9F\Internet_of_Boars\IoB_Files\1_WORKING FILES\GIS\GEOPACKAGE\Christos\Resistance_Maps_Scenarios\General\extent.shp")  # disabled

# ---- group: Cum_curmap
file_path = FilePath("Z:\.shortcut-targets-by-id\1SywzPMZPhkdick32NCYa-c09GZFcjx9F\Internet_of_Boars\IoB_Files\1_WORKING FILES\GIS\GEOPACKAGE\Christos\Resistance_Maps_Scenarios\General\outputs\outputs general_cum_curmap.asc")  # disabled

# ----
number_slider_3 = Slider(1000, range=0..1000)
importshp_2 = ImportShapefileFeatures(ShapefilePath=bbox_2, Reproject=True, UTMZone=importshp.UTMZone, TranslationVector=importshp.TranslationVector)  # -> Points, Metadata, UTMZone, TranslationVector; disabled
cluster = Cluster(F=file_path)  # -> values_2, W_2, H_2; disabled
rectangle_2 = Rectangle(Plane=PlaneXY(0, 0, 0), XSize=number_slider_3, YSize=number_slider_3, Radius=0)  # -> Rectangle, Length
pt_2 = ConstructPoint(XCoordinate=0, YCoordinate=0, ZCoordinate=0)
number_slider_4 = Slider(100, range=0..1000)
pline_2 = PolyLine(Vertices=importshp_2.Points, Closed=invert(False))  # disabled
arrrec_2 = RectangularArray(Geometry=pt_2, Cell=rectangle_2.Rectangle, XCount=number_slider_4, YCount=number_slider_4)  # -> Geometry, Transform
panel = Panel(importshp_2.Points)  # disabled
bnd = Bounds(Numbers=flatten(cluster.values_2))  # disabled
dam = DataDam(DataA=arrrec_2.Geometry, BufferDelay=10000000, BufferMode=0)
dedomain = DeconstructDomain(Domain=bnd)  # -> Start, End; disabled
bbox_3 = BoundingBox(Content=dam, Plane=PlaneXY(0, 0, 0), UnionBox=True)  # -> Box, Box_2
gradient = Gradient(
    LowerLimit=dedomain.Start,
    UpperLimit=dedomain.End,
    Parameter=cluster.values_2,
    stops=[0: RGB(172, 220, 250), 0.173: RGB(61, 54, 186)])  # disabled
mplane = MeshPlane(Boundary=pline_2, WidthCount=cluster.W_2, HeightCount=cluster.H_2)  # -> Mesh, Area; disabled
image = ImageSampler(srf_cp.UVPoint, Filter="Blue", Interpolate=False, Umax=1, Umin=0, Vmax=1, Vmin=0, Wrap=1)
srf_cp_2 = SurfaceClosestPoint(Point=dam, Surface=reparameterize(bbox_3.Box))  # -> Point, UVPoint, Distance
demesh = DeconstructMesh(Mesh=mplane.Mesh)  # -> Vertices, Faces, Colours, Normals; disabled
image_2 = ImageSampler(srf_cp_2.UVPoint, Filter="Blue", Interpolate=False, Umax=1, Umin=0, Vmax=1, Vmin=0, Wrap=1)
image_3 = ImageSampler(srf_cp_2.UVPoint, Filter="Value", Interpolate=False, Umax=1, Umin=0, Vmax=1, Vmin=0, Wrap=1)
range = Range(Domain=image_3, Steps=Slider(5, range=0..10))
conmesh = ConstructMesh(Vertices=demesh.Vertices, Faces=demesh.Faces, Colours=gradient)  # disabled
multiplication = Multiplication(A=image, B=Slider(10000, range=0..10000))
bnd_2 = Bounds(Numbers=image)
panel_2 = Panel("""0
10
30
50
100""")
multiplication_2 = Multiplication(A=image_3, B=100)
viewer = ParamViewer(image_2)
panel_3 = Panel(bnd_2)
bnd_3 = Bounds(Numbers=image_2)
Z = UnitZ(Factor=multiplication)
multiplication_3 = Multiplication(A=image_2, B=Slider(5925, range=0..10000))
sort = SortList(Keys=multiplication_2, ValuesA=multiplication_2)  # -> Keys, ValuesA
panel_4 = Panel(bnd_3)
colour = ColourPicker(PickedColour=RGB(14, 3, 54))
number_slider_5 = Slider(400, range=0..1000)
move = Move(Geometry=srf_cp.Point, Motion=Z)  # -> Geometry, Transform
Z_2 = UnitZ(Factor=multiplication_3)
colour_2 = ColourPicker(PickedColour=RGB(214, 54, 54))
colour_3 = ColourPicker(PickedColour=RGB(109, 191, 158))
colour_4 = ColourPicker(PickedColour=RGB(30, 54, 17))
colour_5 = ColourPicker(PickedColour=RGB(30, 54, 17))
consec = ConsecutiveDomains(Numbers=panel_2, Additive=Toggle(False))

# ----
# generation of 4 types of poligons by sub-domains
number_slider_6 = Slider(38, range=1..50)
multiplication_4 = Multiplication(A=image_2, B=number_slider_6)

item = CherryPicker(multiplication_2, ListIndex=317, TreePath_path="{0;0}")

# ---- group: Square_Size
multiplication_5 = Multiplication(A=image, B=Slider(500, range=0..1000))

# ---- group: Connectivity_Level_Selection
larger = LargerThan(FirstNumber=image, SecondNumber=Slider(0.15, range=0..1))  # -> LargerThan, OrEqualTo

# ----
avr = Average(Input=multiplication_2)
pt_3 = Point(move.Geometry)
pt_4 = Point(srf_cp.Point)
image_4 = ImageSampler(srf_cp.UVPoint, Filter="Colour", Interpolate=False, Umax=1, Umin=0, Vmax=1, Vmin=0, Wrap=1)
fdom = FindDomain(Domains=consec, Number=multiplication_2, Strict=False)  # -> Index, Neighbour

# ---- group: bbox
crv_2 = Curve(crv)  # disabled

# ----
line = LineSDL(Start=srf_cp_2.Point, Direction=Z_2, Length=multiplication_3)
panel_5 = Panel("-100 TO 100")
pt_5 = Point(srf_cp_2.Point)
number_slider_7 = Slider(100, range=0..100)  # disabled

cset = CreateSet(List=fdom.Index)  # -> Set, Map
panel_6 = Panel(cset.Set)
addition = Addition(A=panel_6, B=3)
sort_2 = SortList(Keys=addition, ValuesA=addition)  # -> Keys, ValuesA
item_2 = ListItem(List=sort_2.ValuesA, Index=0, Wrap=True)  # -> Item, Item1, Item2, Item3
merge = Merge(Data1=item_2.Item, Data2=item_2.Item1, Data3=item_2.Item2, Data4=item_2.Item3)
item_3 = ListItem(List=merge, Index=fdom.Index, Wrap=True)

dom = ConstructDomain(DomainStart=expr("-X", number_slider_5), DomainEnd=number_slider_5)
panel_7 = Panel(item)
ln = Line(StartPoint=pt_4, EndPoint=pt_3)
rectangle_3 = Rectangle(Plane=pt_4, XSize=dom, YSize=dom, Radius=0)  # -> Rectangle, Length
cset_2 = CreateSet(List=image_4)  # -> Set, Map
multiplication_6 = Multiplication(A=multiplication_4, B=Slider(0.7, range=0..2))
cir = Circle(Plane=ln, Radius=multiplication_5)
scale = Scale(Geometry=rectangle_3.Rectangle, Center=pt_4, Factor=image)  # -> Geometry, Transform
# Why this doesn't work properly?
sqgrid = Square(Plane=PlaneXY(0, 0, 0), Size=1, ExtentX=5, ExtentY=5)  # -> Cells, Points
panel_8 = Panel("0 to 1")  # disabled
panel_9 = Panel(consec)
bbox_4 = BoundingBox(Content=cir, Plane=PlaneXY(0, 0, 0))  # -> Box, Box_2
data = Data(fdom.Index)
data_2 = Data(image_3)
rectangle_4 = Rectangle(Plane=PlaneXY(0, 0, 0), XSize=panel_8, YSize=panel_8, Radius=0)  # -> Rectangle, Length; disabled
panel_10 = Panel(cset_2.Set)
mplane_2 = MeshPlane(Boundary=rectangle_4.Rectangle, WidthCount=number_slider_7, HeightCount=number_slider_7)  # -> Mesh, Area; disabled
mplane_3 = MeshPlane(Boundary=crv_2, WidthCount=number_slider_7, HeightCount=number_slider_7)  # -> Mesh, Area; disabled
extrcrv = ExtrudeAlong(Base=scale.Geometry, Curve=ln)  # disabled
polygon = Polygon(Plane=pt_5, Radius=multiplication_4, Segments=item_3, FilletRadius=0)  # -> Polygon, Length
extrudem = ExtrudeAsMesh(Polyline=scale.Geometry, Direction=ln, Cap=invert(False))

gradient_2 = Gradient(
    LowerLimit=0,
    UpperLimit=1,
    Parameter=image_4,
    stops=[0: RGB(243, 57, 0), 0.2: RGB(210, 0, 118), 0.268: RGB(236, 27, 60), 0.3: RGB(103, 0, 120), 0.4: RGB(39, 72, 161), 0.5: RGB(1, 192, 229), 0.6: RGB(18, 178, 90), 0.7: RGB(79, 186, 8), 0.8: RGB(220, 237, 32), 0.9: RGB(247, 159, 20), 1: RGB(243, 57, 0)])
conmesh_2 = ConstructMesh(
    Vertices=[Point(0, 0, 0), Point(10, 0, 0), Point(10, 10, 0), Point(0, 10, 0)],
    Faces={A=0, B=1, C=2, D=3},
    Colours=gradient_2)

scale_2 = Scale(Geometry=polygon.Polygon, Center=pt_5, Factor=multiplication_6)  # -> Geometry, Transform
demesh_2 = DeconstructMesh(Mesh=mplane_2.Mesh)  # -> Vertices, Faces, Colours, Normals; disabled
demesh_3 = DeconstructMesh(Mesh=mplane_3.Mesh)  # -> Vertices, Faces, Colours, Normals; disabled
cull = CullPattern(List=extrcrv, CullPattern=larger.LargerThan)
debrep = DeconstructBrep(Brep=cull)  # -> Faces, Edges, Vertices
image_5 = ImageSampler(demesh_2.Vertices, Filter="Colour", Interpolate=False, Umax=1, Umin=0, Vmax=1, Vmin=0, Wrap=1)  # disabled
extr = Extrude(Base=scale_2.Geometry, Direction=line)
number_slider_8 = Slider(56, range=0..100)  # disabled
graph = QuickGraph(data_2, SortOrder=0)
cap = CapHoles(Brep=extr)

# ---- group: Square_Division
item_4 = ListItem(List=debrep.Vertices, Index=Slider(6, range=0..7), Wrap=True)
item_5 = ListItem(List=debrep.Vertices, Index=Slider(5, range=0..7), Wrap=True)
item_6 = ListItem(List=debrep.Vertices, Index=Slider(6, range=0..7), Wrap=True)
item_7 = ListItem(List=debrep.Vertices, Index=Slider(4, range=0..7), Wrap=True)
item_8 = ListItem(List=debrep.Vertices, Index=Slider(7, range=0..7), Wrap=True)
item_9 = ListItem(List=debrep.Vertices, Index=Slider(4, range=0..7), Wrap=True)
inter = InterconnectPoints(Pts=[item_4, item_7, item_5])
inter_2 = InterconnectPoints(Pts=[item_9, item_6, item_8])
boundary = BoundarySurfaces(Edges=inter_2)
boundary_2 = BoundarySurfaces(Edges=inter)

# ----
cset_3 = CreateSet(List=multiplication_2)  # -> Set, Map
sort_3 = SortList(Keys=cset_3.Set)  # -> Keys, ValuesA
panel_11 = Panel(sort_3.Keys)

multiplication_7 = Multiplication(A=image_5, B=number_slider_8)  # disabled
mesh = MeshBrep(
    Brep=cap,
    Settings={GridMaxCount=0, GridMinCount=16, JaggedSeams=False, MaxEdgeLength=0, MinEdgeLength=0.0001, MinTolerance=0, Refine=True, RefineAngle=0, RelativeTolerance=0.65, SimplePlanes=True, Tolerance=0})

# ----
# counting amount of different poligons
cset_4 = CreateSet(List=data)  # -> Set, Map
mindex = MemberIndex(Set=data, Member=cset_4.Set)  # -> flatten(Index), Count
panel_12 = Panel(mindex.Count)

cir_2 = Circle(Plane=demesh_3.Vertices, Radius=multiplication_7)  # disabled

# ----
# counting amount of different colour indexes in image sampler
cset_5 = CreateSet(List=data_2)  # -> Set, Map
mindex_2 = MemberIndex(Set=data_2, Member=cset_5.Set)  # -> flatten(Index), Count
panel_13 = Panel(mindex_2.Count)

lng = ListLength(List=cset_5.Set)
pop3d = Populate3D(Region={Plane=PlaneXY(0, 0, 0), X=Domain(0, 1), Y=Domain(0, 1), Z=Domain(0, 1)}, Count=lng, Seed=2)
pdecon = Deconstruct(Point=pop3d)  # -> XComponent, YComponent, ZComponent
frgb = ColourRGBF(Alpha=1, Red=pdecon.XComponent, Green=pdecon.YComponent, Blue=pdecon.ZComponent)
item_10 = ListItem(List=frgb, Index=mindex_2.Index, Wrap=True)
preview = CustomPreview(Geometry=mesh, Shader=item_10)

swatch = ColourSwatch(SwatchColor=RGB(242, 0, 145))  # disabled
panel_14 = Panel(cset_4.Set)
preview_2 = CustomPreview(Geometry=cir_2, Material=swatch)  # disabled
ma = MassAddition(Input=flatten(panel_12))  # -> Result, PartialResults
ma_2 = MassAddition(Input=panel_13)  # -> Result, PartialResults
mesh_2 = Mesh(flatten([boundary_2, boundary]))
panel_15 = Panel(ma.Result)
panel_16 = Panel(ma_2.Result)
remap = RemapNumbers(Value=mesh_2, Source=Domain(0, 1), Target=Domain(0, 1))  # -> Mapped, Clipped

# ----
# Farms_Barcelona
path_2 = FilePath("Z:\.shortcut-targets-by-id\1SywzPMZPhkdick32NCYa-c09GZFcjx9F\Internet_of_Boars\IoB_Files\1_WORKING FILES\GIS\SPATIAL DATA\Shapefiles\For Rhino big axonometry\shp_agricultural(code 211-244)\shp_agricultural(code 211-244).shp")

# ----
# Industrial Spaces_Barcelona
path_3 = FilePath("Z:\.shortcut-targets-by-id\1SywzPMZPhkdick32NCYa-c09GZFcjx9F\Internet_of_Boars\IoB_Files\1_WORKING FILES\GIS\SPATIAL DATA\Shapefiles\For Rhino big axonometry\shp_industrial zones\shp_industrial zones.shp")

# ----
# Urban Green Areas
path_4 = FilePath()

# ----
# Forests_Barcelona
path_5 = FilePath("Z:\.shortcut-targets-by-id\1SywzPMZPhkdick32NCYa-c09GZFcjx9F\Internet_of_Boars\IoB_Files\1_WORKING FILES\GIS\SPATIAL DATA\Shapefiles\For Rhino big axonometry\shp_natural areas (forests+schrublands)\shp_natural areas.shp")
importshp_3 = ImportShapefileFeatures(
    ShapefilePath=path_5,
    Reproject=True,
    UTMZone=importshp.UTMZone,
    TranslationVector=importshp.TranslationVector,
    CroppingGeometry=crv)  # -> Points, Metadata, UTMZone, TranslationVector
pline_3 = PolyLine(Vertices=importshp_3.Points, Closed=False)
redpline_2 = Reduce(Polyline=pline_3, Tolerance=Slider(100, range=0..1010))  # -> Polyline, Reduction

# ----
# Highways
path_6 = FilePath("Z:\.shortcut-targets-by-id\1SywzPMZPhkdick32NCYa-c09GZFcjx9F\Internet_of_Boars\IoB_Files\1_WORKING FILES\GIS\SPATIAL DATA\Shapefiles\For Rhino big axonometry\shp_main roads\shp_fragmenting main roads.shp")
importshp_4 = ImportShapefileFeatures(
    ShapefilePath=path_6,
    Reproject=True,
    UTMZone=importshp_3.UTMZone,
    TranslationVector=importshp_3.TranslationVector,
    CroppingGeometry=crv)  # -> Points, Metadata, UTMZone, TranslationVector
pline_4 = PolyLine(Vertices=importshp_4.Points, Closed=False)
crv_3 = Curve(pline_4)
cls = Closed(Curve=crv_3)  # -> Closed, Periodic
dispatch = Dispatch(List=crv_3, DispatchPattern=cls.Closed)  # -> ListA, ListB
crv_4 = Curve(dispatch.ListA)
redpline_3 = Reduce(Polyline=crv_4, Tolerance=Slider(20, range=0..1010))  # -> Polyline, Reduction
boundarym = BoundaryMesh(Polyline=redpline_3.Polyline)
trim = TrimTree(Tree=boundarym, Depth=1)
mjoin = MeshJoin(Meshes=trim)

importshp_5 = ImportShapefileFeatures(
    ShapefilePath=path_4,
    Reproject=True,
    UTMZone=importshp_3.UTMZone,
    TranslationVector=importshp_3.TranslationVector,
    CroppingGeometry=crv)  # -> Points, Metadata, UTMZone, TranslationVector
pline_5 = PolyLine(Vertices=importshp_5.Points, Closed=False)
crv_5 = Curve(pline_5)
cls_2 = Closed(Curve=crv_5)  # -> Closed, Periodic
dispatch_2 = Dispatch(List=crv_5, DispatchPattern=cls_2.Closed)  # -> ListA, ListB
crv_6 = Curve(dispatch_2.ListA)
redpline_4 = Reduce(Polyline=crv_6, Tolerance=Slider(20, range=0..1010))  # -> Polyline, Reduction
boundarym_2 = BoundaryMesh(Polyline=redpline_4.Polyline)
trim_2 = TrimTree(Tree=boundarym_2, Depth=1)
mjoin_2 = MeshJoin(Meshes=trim_2)

crv_7 = Curve(redpline_2.Polyline)
cls_3 = Closed(Curve=crv_7)  # -> Closed, Periodic
dispatch_3 = Dispatch(List=crv_7, DispatchPattern=cls_3.Closed)  # -> ListA, ListB
crv_8 = Curve(dispatch_3.ListA)

boundarym_3 = BoundaryMesh(Polyline=crv_8)

trim_3 = TrimTree(Tree=boundarym_3, Depth=1)
mjoin_3 = MeshJoin(Meshes=trim_3)

mcol = MeshColours(Mesh=mjoin_3, Colours=colour_3)
mcol_2 = MeshColours(Mesh=mjoin_2, Colours=colour_5)
mcol_3 = MeshColours(Mesh=mjoin, Colours=colour_4)

importshp_6 = ImportShapefileFeatures(
    ShapefilePath=path_2,
    Reproject=True,
    UTMZone=importshp_3.UTMZone,
    TranslationVector=importshp_3.TranslationVector,
    CroppingGeometry=crv)  # -> Points, Metadata, UTMZone, TranslationVector
pline_6 = PolyLine(Vertices=importshp_6.Points, Closed=False)

crv_9 = Curve(pline_6)
cls_4 = Closed(Curve=crv_9)  # -> Closed, Periodic
dispatch_4 = Dispatch(List=crv_9, DispatchPattern=cls_4.Closed)  # -> ListA, ListB
crv_10 = Curve(dispatch_4.ListA)

redpline_5 = Reduce(Polyline=crv_10, Tolerance=Slider(0, range=0..1010))  # -> Polyline, Reduction
boundarym_4 = BoundaryMesh(Polyline=redpline_5.Polyline)
trim_4 = TrimTree(Tree=boundarym_4, Depth=1)
mjoin_4 = MeshJoin(Meshes=trim_4)

mcol_4 = MeshColours(Mesh=mjoin_4, Colours=colour)

importshp_7 = ImportShapefileFeatures(
    ShapefilePath=path_3,
    Reproject=True,
    UTMZone=importshp_3.UTMZone,
    TranslationVector=importshp_3.TranslationVector,
    CroppingGeometry=crv)  # -> Points, Metadata, UTMZone, TranslationVector
pline_7 = PolyLine(Vertices=importshp_7.Points, Closed=False)

crv_11 = Curve(pline_7)
cls_5 = Closed(Curve=crv_11)  # -> Closed, Periodic
dispatch_5 = Dispatch(List=crv_11, DispatchPattern=cls_5.Closed)  # -> ListA, ListB
crv_12 = Curve(dispatch_5.ListA)

redpline_6 = Reduce(Polyline=crv_12, Tolerance=Slider(20, range=0..1010))  # -> Polyline, Reduction
boundarym_5 = BoundaryMesh(Polyline=redpline_6.Polyline)
trim_5 = TrimTree(Tree=boundarym_5, Depth=1)
mjoin_5 = MeshJoin(Meshes=trim_5)

mcol_5 = MeshColours(Mesh=mjoin_5, Colours=colour_2)

# ==== cluster Cluster
F = ClusterInput()
file = ReadFile(File=F, PerLineParse=True)
split = SplitList(List=file, Index="6")  # -> ListA, ListB
split_2 = TextSplit(Text=split.ListB, Separators=" ")  # -> simplify(Result)
path_mapper = PathMapper(split_2, source="{A}(i)", target="{i}(A)")
num = Number(path_mapper)
tstat = TreeStatistics(Tree=num)  # -> Paths, Length, Count
rev = ReverseList(List=num)
item = ListItem(List=tstat.Length, Index=0, Wrap=True)
merge = Merge(Data1=item, Data2=tstat.Count)
subtraction = Subtraction(A=merge, B="1")
item_2 = ListItem(List=subtraction, Index=0, Wrap=True)  # -> Item, Item1
flatten = FlattenTree(Tree=rev, Path="{0}")
values = Number(flatten)
W = Integer(item_2.Item)
H = Integer(item_2.Item1)
values_2 = ClusterOutput(values)
W_2 = ClusterOutput(W)
H_2 = ClusterOutput(H)
