# Grasshopper definition Coordinates_to_BBOX.gh (Grasshopper 1.0.7)

https_boundingbox_klokantech_com_exporte = Panel("1.78552,41.219357,2.402815,41.649202")  # "https://boundingbox.klokantech.com/ exported as CSV"

split = TextSplit(Text=https_boundingbox_klokantech_com_exporte, Separators=",")
item = ListItem(List=split, Index=0, Wrap=True)  # -> Item, Item1, Item2, Item3
pt = ConstructPoint(XCoordinate=item.Item2, YCoordinate=item.Item3, ZCoordinate=0)
pt_2 = ConstructPoint(XCoordinate=item.Item, YCoordinate=item.Item1, ZCoordinate=0)
rec_2pt = Rectangle2Pt(Plane=PlaneXY(0, 0, 0), PointA=pt_2, PointB=pt, Radius=0)  # -> Rectangle, Length

# ----
# rectangle to extract
#  maps from
crv = Curve(rec_2pt.Rectangle)

# ----
# dam to
# renew data
# incrementally
dam = DataDam(DataA=crv, BufferDelay=10000000, BufferMode=0)
