# Grasshopper definition stakeholder scheme connection.gh (Grasshopper 1.0.7)
# plug-ins: Bifocals, Human

series = Series(Start=3, Step=6, Count=3)
series_2 = Series(Start=3, Step=6, Count=2)
series_3 = Series(Start=3, Step=6, Count=2)
panel = Panel(series)
panel_2 = Panel(series_2)
panel_3 = Panel(series_3)
# stakeholders centers
crv = Curve(<curve referenced from the Rhino model>)
crv_2 = Curve(<curve referenced from the Rhino model>)
crv_3 = Curve(<curve referenced from the Rhino model>)
crv_4 = Curve(<curve referenced from the Rhino model>)
crv_5 = Curve(<curve referenced from the Rhino model>)

# ----
# select toolsets
crv_6 = Curve([<curve referenced from the Rhino model> x7])
area = Area(Geometry=crv_6)  # -> Area, Centroid
item = ListItem(List=area.Centroid, Index=0, Wrap=True)  # -> Item, Item1, Item2, Item3, Item4, Item5, Item6

X = UnitX(Factor=expr("-x", panel_3))
X_2 = UnitX(Factor=panel_3)
area_2 = Area(Geometry=crv)  # -> Area, Centroid
vec = Vector([X_2, X])
move = Move(Geometry=area_2.Centroid, Motion=vec)  # -> Geometry, Transform

# ----
# fence scheme center
crv_7 = Curve(<curve referenced from the Rhino model>)
end = EndPoints(Curve=crv_7)  # -> Start, End
ln = Line(StartPoint=end.Start, EndPoint=end.End)
loft = Loft(
    Curves=flatten([crv_7, ln]),
    Options={Adjust=False, Closed=False, LoftEnds=0, LoftSimp=0, LoftType=0, Rebuild=10, Refit=0.01})
area_3 = Area(Geometry=loft)  # -> Area, Centroid
move_2 = Move(Geometry=area_3.Centroid, Motion=vec)  # -> Geometry, Transform
sort_pt = SortPoints(Points=move_2.Geometry)  # -> Points, Indices

# ----
# go scheme center
crv_8 = Curve([<curve referenced from the Rhino model> x2])
loft_2 = Loft(Curves=crv_8, Options={Adjust=False, Closed=False, LoftEnds=0, LoftSimp=0, LoftType=0, Rebuild=10, Refit=0.01})
area_4 = Area(Geometry=loft_2)  # -> Area, Centroid

X_3 = UnitX(Factor=expr("-x", panel))
area_5 = Area(Geometry=crv_5)  # -> Area, Centroid
X_4 = UnitX(Factor=panel)
vec_2 = Vector([X_4, X_3])
move_3 = Move(Geometry=area_5.Centroid, Motion=vec_2)  # -> Geometry, Transform

X_5 = UnitX(Factor=expr("-x", panel_2))
area_6 = Area(Geometry=crv_4)  # -> Area, Centroid
X_6 = UnitX(Factor=panel_2)
vec_3 = Vector([X_6, X_5])
move_4 = Move(Geometry=area_6.Centroid, Motion=vec_3)  # -> Geometry, Transform

X_7 = UnitX(Factor=expr("-x", panel_3))
area_7 = Area(Geometry=crv_2)  # -> Area, Centroid
X_8 = UnitX(Factor=panel_3)
vec_4 = Vector([X_8, X_7])
move_5 = Move(Geometry=area_7.Centroid, Motion=vec_4)  # -> Geometry, Transform

X_9 = UnitX(Factor=expr("-x", panel_3))
area_8 = Area(Geometry=crv_3)  # -> Area, Centroid
X_10 = UnitX(Factor=panel_3)
vec_5 = Vector([X_10, X_9])
move_6 = Move(Geometry=area_8.Centroid, Motion=vec_5)  # -> Geometry, Transform

sort_pt_2 = SortPoints(Points=flatten([move_4.Geometry, area_6.Centroid]))  # -> Points, Indices
sort_pt_3 = SortPoints(Points=move_5.Geometry)  # -> Points, Indices
sort_pt_4 = SortPoints(Points=move_3.Geometry)  # -> Points, Indices

Y = UnitY(Factor=Slider(58, range=0..1200))
neg = Negative(Value=Y)

Y_2 = UnitY(Factor=Slider(57, range=0..1200))
neg_2 = Negative(Value=Y_2)

pt = Point([item.Item, item.Item1, item.Item2, item.Item3, item.Item4, item.Item5])
pt_2 = Point([item.Item, item.Item1, item.Item3, item.Item6])
pt_3 = Point([item.Item, item.Item3, item.Item6, item.Item2])
pt_4 = Point([item.Item1, item.Item2, item.Item3, item.Item4, item.Item6])
pt_5 = Point([item.Item, item.Item3, item.Item4, item.Item5])
move_7 = Move(Geometry=area_4.Centroid, Motion=vec_2)  # -> Geometry, Transform
move_8 = Move(Geometry=area_4.Centroid, Motion=vec_3)  # -> Geometry, Transform
move_9 = Move(Geometry=area_4.Centroid, Motion=vec_4)  # -> Geometry, Transform
sort_pt_5 = SortPoints(Points=pt)  # -> Points, Indices
sort_pt_6 = SortPoints(Points=pt_4)  # -> Points, Indices
sort_pt_7 = SortPoints(Points=pt_2)  # -> Points, Indices
sort_pt_8 = SortPoints(Points=pt_3)  # -> Points, Indices
sort_pt_9 = SortPoints(Points=pt_5)  # -> Points, Indices
sort_pt_10 = SortPoints(Points=flatten([move_8.Geometry, area_4.Centroid]))  # -> Points, Indices
sort_pt_11 = SortPoints(Points=move_7.Geometry)  # -> Points, Indices
sort_pt_12 = SortPoints(Points=move_9.Geometry)  # -> Points, Indices
bzspan = BezierSpan(StartPoint=move_2.Geometry, StartTangent=neg_2, EndPoint=move_6.Geometry, EndTangent=Y_2)  # -> Curve, Length, Domain
bzspan_2 = BezierSpan(StartPoint=sort_pt_10.Points, StartTangent=neg_2, EndPoint=sort_pt_2.Points, EndTangent=Y_2)  # -> Curve, Length, Domain
# lower part
bzspan_3 = BezierSpan(StartPoint=move_2.Geometry, StartTangent=neg_2, EndPoint=move.Geometry, EndTangent=Y_2)  # -> Curve, Length, Domain
bzspan_4 = BezierSpan(StartPoint=sort_pt_12.Points, StartTangent=neg_2, EndPoint=sort_pt_3.Points, EndTangent=Y_2)  # -> Curve, Length, Domain
bzspan_5 = BezierSpan(StartPoint=sort_pt_11.Points, StartTangent=neg_2, EndPoint=sort_pt_4.Points, EndTangent=Y_2)  # -> Curve, Length, Domain
# upper part
bzspan_6 = BezierSpan(StartPoint=sort_pt_9.Points, StartTangent=neg, EndPoint=sort_pt.Points, EndTangent=Y)  # -> Curve, Length, Domain
bzspan_7 = BezierSpan(StartPoint=sort_pt_5.Points, StartTangent=neg, EndPoint=sort_pt_11.Points, EndTangent=Y)  # -> Curve, Length, Domain
bzspan_8 = BezierSpan(StartPoint=sort_pt_7.Points, StartTangent=neg, EndPoint=sort_pt_12.Points, EndTangent=Y)  # -> Curve, Length, Domain
bzspan_9 = BezierSpan(StartPoint=sort_pt_6.Points, StartTangent=neg, EndPoint=sort_pt_10.Points, EndTangent=Y)  # -> Curve, Length, Domain
bzspan_10 = BezierSpan(StartPoint=sort_pt_8.Points, StartTangent=neg, EndPoint=sort_pt.Points, EndTangent=Y)  # -> Curve, Length, Domain
join = JoinCurves(Curves=[bzspan_3.Curve, bzspan_6.Curve], Preserve=False)
join_2 = JoinCurves(Curves=[bzspan_7.Curve, bzspan_5.Curve], Preserve=False)
join_3 = JoinCurves(Curves=[bzspan_10.Curve, bzspan.Curve], Preserve=False)
join_4 = JoinCurves(Curves=[bzspan_9.Curve, bzspan_2.Curve], Preserve=False)
join_5 = JoinCurves(Curves=[bzspan_8.Curve, bzspan_4.Curve], Preserve=False)
geo = Geometry(join_3)
geo_2 = Geometry(join_2)
geo_3 = Geometry(join)
geo_4 = Geometry(join_5)
geo_5 = Geometry(join_4)
entwine = Entwine(Branch00=geo_3, Branch01=geo, Branch02=geo_2, Branch03=geo_5, Branch04=geo_4, FlattenInputs=True)
series_4 = Series(Start=0, Step=expr("1/x", "5"), Count="5")
gradient = Gradient(
    LowerLimit=0,
    UpperLimit=1,
    Parameter=series_4,
    stops=[0: RGB(243, 57, 0), 0.1: RGB(236, 27, 60), 0.2: RGB(210, 0, 118), 0.3: RGB(103, 0, 120), 0.4: RGB(39, 72, 161), 0.5: RGB(1, 192, 229), 0.6: RGB(18, 178, 90), 0.7: RGB(79, 186, 8), 0.8: RGB(220, 237, 32), 0.9: RGB(247, 159, 20), 1: RGB(243, 57, 0)])
createatts = CreateAttributes(LayerName="connect", Color=gradient, PlotWeight=0.3, PlotColor=gradient, enableFullPath=False)  # -> graft(ObjectAttributes)
bake = BakeGeometry(Bake=Toggle(False), Geometry=entwine, Attributes=createatts, DeleteOldBakes=False, PreserveTrees=False)
layers = CreateModifyLayers(LayerName="connect", DeleteLayer=False, enableFullPath=False)  # -> LayerNames, LayerFullPath
